# Grasshopper definition angkor.gh (Grasshopper 0.9.14)

seed1 = Slider(9, range=2..50)
density = Slider(10, range=1..20)
seed2 = Slider(50, range=2..50)
slider = Slider(0.6, range=0.2..2)
num = Number(density)
num_2 = Number(seed2)
num_3 = Number(seed1)
cir = Circle(Plane=PlaneXY(0, 0, 0), Radius=20)
len = Length(Curve=cir)
eval = Evaluate(F="x-10", x=len)
dom = Domain(DomainStart=0, DomainEnd=len)
vb = VBScript(x=slider)  # -> out, A
# ---------- vb: VB ----------
    Dim radius As Double
    radius = x
    Dim circle As Circle
    Dim cylinder As Cylinder
    Dim mesh As Mesh
    'New Rhino.Geometry.Circle(
    circle = New Rhino.Geometry.Circle(radius)
    cylinder = New Rhino.Geometry.Cylinder(circle, 1)
    mesh = Rhino.Geometry.Mesh.CreateFromCylinder(cylinder, 1, 9)
    A = RhinoDoc.ActiveDoc.Objects.AddMesh(mesh)
# ---------- end vb ----------
dom_2 = Domain(DomainStart=10, DomainEnd=eval)
random = Random(Range=dom, Number=num, Seed=num_3)
random_2 = Random(Range=dom_2, Number=num, Seed=num_2)
addition = Addition(A=random, B=random_2)
hframe = HorizontalFrame(Curve=cir, Parameter=random)
hframe_2 = HorizontalFrame(Curve=cir, Parameter=addition)
ln = Line(StartPoint=hframe, EndPoint=hframe_2)
crv = Curve(ln)
divlength = DivideLength(Curve=crv, Length=slider)  # -> Points, Tangents, Parameters
move = Move(Geometry=vb.A, Motion=divlength.Points)  # -> Geometry, Transform
